# Grasshopper definition 210701_compas_path_plan.gh (Grasshopper 1.0.7)

# ---- group: members
# INPUT GEOMETRY
crv = Curve([<curve referenced from the Rhino model> x45])
number_slider = Slider(7, range=0..44)
python = GhPythonScript(n=number_slider)  # -> rob_num; inputs n: Int32
# ---------- python: Python ----------
#Robot Order

order = [
2, #0
1, #1
2, #2
1, #3
2, #4
1, #5
2, #6
1, #7
2, #8
2, #9
1, #10
2, #11
2, #12
1, #13
2, #14
2, #15
1, #16
1, #17
2, #18
1, #19
2, #20
1, #21
2, #22
2, #23
2, #24
1, #25
2, #26
1, #27
2, #29
2, #28
1, #30
2, #31
1, #32
1, #33
1, #34
2, #33
2, #38
1, #36
1, #37
#done
2, #36
2, #37
2, #39
2, #41
2, #42
1, #43
]

rob_num = order[n]
# ---------- end python ----------
python_2 = GhPythonScript(n=number_slider)  # -> idx; inputs n: Int32
# ---------- python_2: Python ----------
idx = range(n+1)

print idx
# ---------- end python_2 ----------
panel = Panel(number_slider)
panel_2 = Panel(python)
data = Data(crv)
data_2 = Data(python_2)

# ---- group: current member curves
data_3 = Data(data_2)
data_4 = Data(data)
item = ListItem(List=data_4, Index=data_3, Wrap=True)
crv_2 = Curve(item)

# ----
# GEOMETRIC INFO FOR FABRICATION
panel_3 = Panel(panel)

panel_4 = Panel("C:/Users/Edvard/Documents/GitHub/workshop_princeton_2021/ACADIA/input_data/")  # disabled
button = Button()  # disabled
panel_5 = Panel("member_rotations.json")  # disabled
python_3 = GhPythonScript(path=panel_4, filename=panel_5, save_data=button)  # inputs rotations: list; disabled
# ---------- python_3: Python ----------
import os
from compas_fab.utilities import write_data_to_json

output_data = {}
if save_data:
    for i,c in enumerate(rotations):
        output_data['member_{}'.format(i)] = c

    print output_data
    write_data_to_json(output_data, os.path.join(path, filename))
# ---------- end python_3 ----------

# ----
# R2 PICKUP PLANES
panel_6 = Panel("3246.00")
pt = ConstructPoint(XCoordinate=panel_6, YCoordinate="1836.50", ZCoordinate="733.40")
Z = UnitZ(Factor="450.00")
division = Division(A=pt, B=1000)
division_2 = Division(A=Z, B=1000)
pl = ConstructPlane(Origin=division, XAxis=Vector(-1, 0, 0), YAxis=Vector(0, 1, 0))
pl_2 = ConstructPlane(Origin=pt, XAxis=Vector(-1, 0, 0), YAxis=Vector(0, 1, 0))
move = Move(Geometry=pl, Motion=division_2)  # -> Geometry, Transform
move_2 = Move(Geometry=pl_2, Motion=Z)  # -> Geometry, Transform
pln = Plane(move.Geometry)
pln_2 = Plane(pl)
pln_3 = Plane(move_2.Geometry)
pln_4 = Plane(pl_2)

# ----
# R1 - PICKUP PLANES
panel_7 = Panel("3246.00")
pt_2 = ConstructPoint(XCoordinate=panel_7, YCoordinate="1838.30", ZCoordinate="729.60")
Z_2 = UnitZ(Factor="450.00")
division_3 = Division(A=pt_2, B=1000)
division_4 = Division(A=Z_2, B=1000)
pl_3 = ConstructPlane(Origin=division_3, XAxis=Vector(-1, 0, 0), YAxis=Vector(0, 1, 0))
pl_4 = ConstructPlane(Origin=pt_2, XAxis=Vector(-1, 0, 0), YAxis=Vector(0, 1, 0))
move_3 = Move(Geometry=pl_3, Motion=division_4)  # -> Geometry, Transform
move_4 = Move(Geometry=pl_4, Motion=Z_2)  # -> Geometry, Transform
pln_5 = Plane(move_3.Geometry)
pln_6 = Plane(pl_3)
pln_7 = Plane(move_4.Geometry)
pln_8 = Plane(pl_4)

rob_num = Number(panel_2)
panel_8 = Panel(rob_num)

python_4 = GhPythonScript()  # -> t_a
# ---------- python_4: Python ----------
from compas.geometry import Frame
from compas.geometry import Point
from compas_ghpython import draw_frame
from compas.geometry import Transformation

from compas_rhino.geometry import RhinoPlane

wobj_A = Frame.from_quaternion([0.999964,0.00426176,-0.00158504,-0.00717332])
wobj_A.point = [-681.039,1564.71,817.284]

f_a = RhinoPlane.from_geometry(wobj_A).to_compas() 
print(f_a)

t_a = Transformation.from_frame(f_a)
print t_a
# ---------- end python_4 ----------

pln_9 = Plane(pln_7)
pln_10 = Plane(pln_8)
merge = Merge(Data1=pln_9, Data2=pln_10)
python_5 = GhPythonScript(p_send=merge, t_a=python_4)  # -> f_send; inputs p_send: list
# ---------- python_5: Python ----------
from compas.geometry import Frame
from compas_ghpython import draw_frame
from compas_rhino.geometry import RhinoPlane
#
f_send = []
for p in p_send:
    f = RhinoPlane.from_geometry(p).to_compas()
    f_trans = f.transformed(t_a.inverse())
    f_send.append(f_trans)
    
print f_send
# ---------- end python_5 ----------

pln_11 = Plane(pln_3)
pln_12 = Plane(pln_4)
merge_2 = Merge(Data1=pln_11, Data2=pln_12)
python_6 = GhPythonScript(p_send=merge_2, t_a=python_4)  # -> f_send; inputs p_send: list; same code as python_5

# ----
# Robot 1
j1 = Slider(-81.69, range=-180..180)
j2 = Slider(0, range=-90..150)
j3 = Slider(0, range=-180..75)
j4 = Slider(0, range=-400..400)
j5 = Slider(97.15, range=-125..120)
j6 = Slider(183.05, range=-400..400)
# FK - Preset Configs
track = Slider(0, range=0..4)
data_5 = Data([j1, j2, j3, j4, j5, j6, track])

# ----
# Robot 2
j1_2 = Slider(92.58, range=-180..180)
j2_2 = Slider(0, range=-90..150)
j3_2 = Slider(0, range=-180..75)
j4_2 = Slider(0, range=-400..400)
j5_2 = Slider(90, range=-125..120)
j6_2 = Slider(190.17, range=-400..400)
track_2 = Slider(4, range=0..4)
data_6 = Data([j1_2, j2_2, j3_2, j4_2, j5_2, j6_2, track_2])

list = ValueList({"Forward Kinematics": 0, "Inverse Kinematics": 1, "Preset Start Planning Config": 2, "Preset Return Config": 3}, selected="Preset Start Planning Config")
place_far = Slider(0.94, range=0..1.5)
num = Number(place_far)

# ----
# INPUT PARAMETERS
# can update placement plane location manually during path planning or use default "place_far" value
panel_9 = Panel("C:/Users/Edvard/Documents/GitHub/workshop_princeton_2021/ACADIA/input_data/")
panel_10 = Panel("C:/Users/Edvard/Documents/GitHub/workshop_princeton_2021/ACADIA/input_data/")
python_7 = GhPythonScript(path=panel_10, filename="member_rotations.json", read_data=Toggle(False))  # -> rotations
# ---------- python_7: Python ----------
import os
from compas_fab.utilities import read_data_from_json
from compas_fab.robots import Configuration

if read_data:
    data = read_data_from_json(os.path.join(path, filename))
    
    
print len(data)
print data
print data['member_29']

rotations = []
for i in range(len(data)):
    rotations.append(data['member_{}'.format(i)])

print rotations
# ---------- end python_7 ----------
python_8 = GhPythonScript(path=panel_9, filename="input_params.json", read_data=Toggle(False))  # -> node_diameter, member_offset, cross_section, place_close, place_far
# ---------- python_8: Python ----------
import os
from compas_fab.utilities import read_data_from_json

if read_data:
    data = read_data_from_json(os.path.join(path, filename))

print data

node_diameter = data['node_diameter']
member_offset = data['member_dist_from_node']
cross_section = data['cross_section_dim']
place_far = data['offset_place_far']
place_close = data['offset_place_close']
# ---------- end python_8 ----------
num_2 = Number(python_8.node_diameter)
num_3 = Number(python_8.member_offset)
num_4 = Number(python_8.cross_section)
num_5 = Number(python_8.place_close)
data_7 = Data(python_7)
num_6 = Number(num)

# ---- group: nodes
pt_3 = Point([<point referenced from the Rhino model> x16])
panel_11 = Panel(num_2)
sph = Sphere(Base=pt_3, Radius=panel_11)

# ---- group: cross-section
# 1 3/16" (30.16mm) section.
# this dist is to corner
panel_12 = Panel(num_4)
division_5 = Division(A=panel_12, B="sqrt(2)")
polygon = Polygon(Plane=PlaneXY(0, 0, 0), Radius=division_5, Segments="4", FilletRadius=0)  # -> Polygon, Length
rotate = Rotate(Geometry=polygon.Polygon, Angle=degrees("45"), Plane=PlaneXY(0, 0, 0))  # -> Geometry, Transform
crv_3 = Curve(rotate.Geometry)

# ----
num_7 = Number(python_8.place_far)

# ---- group: member info
len = Length(Curve=crv_2)
midpt = CurveMiddle(Curve=crv_2)
panel_13 = Panel(num_3)
panel_14 = Panel(num_2)
pl_5 = PlaneNormal(Origin=midpt, ZAxis=crv_2)
python_9 = GhPythonScript(radius=panel_14, offset=panel_13, len=len)  # -> z_factor; inputs len: list
# ---------- python_9: Python ----------
len_reduce = (radius + offset)*2

z_factor = [(l - len_reduce)/l for l in len]
# ---------- end python_9 ----------

# ---- group: member meshes
pframes = PerpFrames(Curve=crv_2, Count=1, Align=True)  # -> Frames, Parameters
crv_4 = Curve(crv_3)
orient = Orient(Geometry=crv_4, Source=PlaneXY(0, 0, 0), Target=simplify(pframes.Frames))  # -> Geometry, Transform
swp1 = Sweep1(Rail=graft(crv_2), Sections=orient.Geometry, Miter=1)

# ---- group: member rotations about axis
data_8 = Data(data_7)
data_9 = Data(data_2)
item_2 = ListItem(List=data_8, Index=data_9, Wrap=True)
panel_15 = Panel(item_2)

# ----
# STRUCTURE AT CURRENT STAGE OF CONSTRUCTION
pln_13 = Plane(pl_5)
pt_4 = Point(midpt)

# ---- group: member placement planes (middle)
pln_14 = Plane(pln_13)
data_10 = Data(item_2)
pt_5 = Point(pt_4)
crv_5 = Curve(crv_2)
rot3d = Rotate3D(
    Geometry=simplify(graft(pln_14)),
    Angle=simplify(graft(data_10)),
    Center=simplify(graft(pt_5)),
    Axis=simplify(graft(crv_5)))  # -> Geometry, Transform
item_3 = ListItem(List=flatten(rot3d.Geometry), Index=panel_3, Wrap=True)
panel_16 = Panel(num_5)
panel_17 = Panel(num_6)
deplane = DeconstructPlane(Plane=item_3)  # -> Origin, XAxis, YAxis, ZAxis
multiplication = Multiplication(A=deplane.XAxis, B=panel_16)
multiplication_2 = Multiplication(A=deplane.XAxis, B=panel_17)
move_5 = Move(Geometry=deplane.Origin, Motion=expr("-x", multiplication))  # -> Geometry, Transform
move_6 = Move(Geometry=deplane.Origin, Motion=expr("-x", multiplication_2))  # -> Geometry, Transform
multiplication_3 = Multiplication(A=move_5.Geometry, B=1000)
multiplication_4 = Multiplication(A=move_6.Geometry, B=1000)
pl_6 = ConstructPlane(Origin=multiplication_3, XAxis=deplane.YAxis, YAxis=deplane.ZAxis)
pl_7 = ConstructPlane(Origin=move_5.Geometry, XAxis=deplane.YAxis, YAxis=deplane.ZAxis)
pl_8 = ConstructPlane(Origin=multiplication_4, XAxis=deplane.YAxis, YAxis=deplane.ZAxis)
pl_9 = ConstructPlane(Origin=move_6.Geometry, XAxis=deplane.YAxis, YAxis=deplane.ZAxis)

# ---- group: as-built structure collision mesh
mesh = Mesh(swp1)
pln_15 = Plane(pln_13)
num_8 = Number(python_9)
scale_nu = ScaleNU(Geometry=simplify(mesh), Plane=simplify(graft(pln_15)), ScaleX=1, ScaleY=1, ScaleZ=simplify(graft(num_8)))  # -> Geometry, Transform
mesh_2 = Mesh(scale_nu.Geometry)
data_11 = Data(item_2)
pt_6 = Point(pt_4)
crv_6 = Curve(crv_2)
rot3d_2 = Rotate3D(
    Geometry=simplify(graft(mesh_2)),
    Angle=simplify(graft(data_11)),
    Center=simplify(graft(pt_6)),
    Axis=simplify(graft(crv_6)))  # -> Geometry, Transform
panel_18 = Panel(panel)
item_4 = ListItem(List=flatten(rot3d_2.Geometry), Index=panel_18, Wrap=True)
mesh_3 = Mesh(rot3d_2.Geometry)

# ---- group: current member collision mesh (at 0,0,0)
num_9 = Number(python_9)
num_10 = Number(len)
panel_19 = Panel(num_4)
panel_20 = Panel(num_4)
multiplication_5 = Multiplication(A=num_9, B=num_10)
box = CenterBox(Base=PlaneXY(0, 0, 0), X=expr("x/2", multiplication_5), Y=expr("x/2", panel_19), Z=expr("x/2", panel_20))
mesh_4 = Mesh(box)
panel_21 = Panel(panel)
item_5 = ListItem(List=flatten(mesh_4), Index=panel_21, Wrap=True)

# ----
# VIZUALIZE
pln_16 = Plane(pl_7)
pln_17 = Plane(pl_9)
pln_18 = Plane(pln_5)
pln_19 = Plane(pln_6)
pln_20 = Plane(pln)
pln_21 = Plane(pln_2)
mesh_5 = Mesh(flatten(mesh_3))
mesh_6 = Mesh(flatten(item_4))
mesh_7 = Mesh(flatten(sph))
merge_3 = Merge(Data1=pln_16, Data2=pln_17)
merge_4 = Merge(Data1=pln_18, Data2=pln_19, Data3=pln_20, Data4=pln_21)
shift = ShiftList(List=mesh_5, Shift=-1, Wrap=False)
preview = CustomPreview(Geometry=mesh_6, Material=ColourSwatch(SwatchColor=RGB(4, 0, 255)))
preview_2 = CustomPreview(Geometry=merge_3, Material=ColourSwatch(SwatchColor=RGB(4, 0, 255)))
preview_3 = CustomPreview(
    Geometry=merge_4,
    Material={diffuse=RGB(0, 238, 255), emission=RGB(0, 71, 76), shine=0.5, specular=RGB(255, 255, 255), transparency=0})
preview_4 = CustomPreview(Geometry=shift, Material=ColourSwatch(SwatchColor=RGB(124, 125, 59)))
preview_5 = CustomPreview(Geometry=mesh_7, Material=ColourSwatch(SwatchColor=RGB(112, 129, 255)))

pln_22 = Plane(pl_8)  # disabled
pln_23 = Plane(pl_6)  # disabled
merge_5 = Merge(Data1=pln_22, Data2=pln_23)  # disabled
python_10 = GhPythonScript(p_send=merge_5, t_a=python_4)  # -> f_send; inputs p_send: list; disabled
# ---------- python_10: Python ----------
from compas.geometry import Frame
from compas_ghpython import draw_frame
from compas_rhino.geometry import RhinoPlane

f_send = []
for p in p_send:
    f = RhinoPlane.from_geometry(p).to_compas()
    f_trans = f.transformed(t_a.inverse())
    f_send.append(f_trans)
    
print f_send
# ---------- end python_10 ----------

panel_22 = Panel("approach")
panel_23 = Panel("place")
pln_24 = Plane(pl_9)
pln_25 = Plane(pl_7)

# ----
# ROBOT CONNECT
# If axis is included then allow the robot to move along track
toggle = BooleanToggle(True)
ros = ROSConnect(connect=Toggle(True))  # -> ros_client, is_connected; inputs port: Int32, connect: Boolean
#   port ip: The ip address ROS. Defaults to 127.0.0.1.
#   port port: The port of ROS. Defaults to 9090.
#   port connect: If True, connects to ROS. If False, disconnects from ROS. Defaults to False.
#   port ros_client: The ROS client.
#   port is_connected: True if connection established.
# ---------- ros: Python ----------
"""
Connect or disconnect to ROS.

COMPAS FAB v0.19.1
"""
from ghpythonlib.componentbase import executingcomponent as component
from scriptcontext import sticky as st

from compas_fab.backends import RosClient
from compas_fab.ghpython.components import create_id


class ROSConnect(component):
    def RunScript(self, ip, port, connect):
        ros_client = None

        ip = ip or '127.0.0.1'
        port = port or 9090

        key = create_id(self, 'ros_client')
        ros_client = st.get(key, None)

        if ros_client:
            st[key].close()
        if connect:
            st[key] = RosClient(ip, port)
            st[key].run(5)

        ros_client = st.get(key, None)
        is_connected = ros_client.is_connected if ros_client else False
        return (ros_client, is_connected)
# ---------- end ros ----------
data_12 = Data(ros.ros_client)
robot = ROSRobot(ros_client=data_12, load=toggle)  # -> robot; inputs load: Boolean
#   port ros_client: The ROS client.
#   port load: If True, loads the robot from ROS. Defaults to False.
# ---------- robot: Python ----------
"""
Load robot directly from ROS.

COMPAS FAB v0.19.1
"""
from compas_ghpython.artists import RobotModelArtist
from ghpythonlib.componentbase import executingcomponent as component
from scriptcontext import sticky as st

from compas_fab.ghpython.components import create_id


class ROSRobot(component):
    def RunScript(self, ros_client, load):
        key = create_id(self, 'robot')

        if ros_client and ros_client.is_connected and load:
            # Load URDF from ROS
            st[key] = ros_client.load_robot(load_geometry=True, precision='12f')
            st[key].artist = RobotModelArtist(st[key].model)

        robot = st.get(key, None)
        if robot:  # client sometimes need to be restarted, without needing to reload geometry
            robot.client = ros_client
        return robot
# ---------- end robot ----------
list_2 = ValueList({"Robot 1": "robot1", "Robot 2": "robot2", "Robot 1 axis": "robot1_axis", "Robot 2 axis": "robot2_axis", "Robot 1 axis gripper": "robot1_axis_gripper", "Robot 2 axis gripper": "robot2_axis_gripper"}, selected="Robot 1 axis gripper")
list_3 = ValueList({"Robot 1": "robot1", "Robot 2": "robot2", "Robot 1 axis": "robot1_axis", "Robot 2 axis": "robot2_axis", "Robot 1 axis gripper": "robot1_axis_gripper", "Robot 2 axis gripper": "robot2_axis_gripper"}, selected="Robot 2 axis gripper")
list_4 = ValueList({"platform": "ecl_platform", "world": "ecl_zero", "wobj_1": "rob1_acadia_EBIT_01", "wobj_2": "rob2_acadia_EBIT_01"}, selected="wobj_2")
list_5 = ValueList({"platform": "ecl_platform", "world": "ecl_zero", "wobj_1": "rob1_acadia_EBIT_01", "wobj_2": "rob2_acadia_EBIT_01"}, selected="wobj_1")
data_13 = Data(list_2)
data_14 = Data(list_3)
panel_24 = Panel(rob_num)
filter = StreamFilter(Gate=panel_24, Stream1=list_5, Stream2=list_4)
data_15 = Data(robot)

python_11 = GhPythonScript(robot=data_15, reset=Button())  # -> out, a
# ---------- python_11: Python ----------
print robot.info()

print robot.get_configurable_joint_names()
print robot.zero_configuration()
# ---------- end python_11 ----------
panel_25 = Panel(python_11.out)
filter_2 = StreamFilter(Gate=panel_8, Stream1=data_13, Stream2=data_14)
data_16 = Data(filter)

data_17 = Data(filter_2)

# ----
# Planning Preset
python_12 = GhPythonScript()  # -> out, config
# ---------- python_12: Python ----------
#ROBOT 1 CONFIG
#Start path planning from

#axis 1-6 + track (mm)
config = [
30,
-3.24,
8.36,
0.19,
84.45,
230,
100]

#config = [
#-37.57,
#-3.24,
#8.36,
#0.19,
#84.45,
#230,
#100]
# ---------- end python_12 ----------
python_13 = GhPythonScript()  # -> out, config
# ---------- python_13: Python ----------
#ROBOT 1 CONFIG
#Start path planning from

#axis 1-6 + track
config = [
40.55,
16.21,
-13.89,
-0.0,
87.68,
130.55,
3900]

#axis 1-6 + track
#config = [40.55,16.21,-13.89,-0.0,87.68,130.55,3900]
# ---------- end python_13 ----------
config = GhPythonScript(robot=data_15, r1=python_12.config, r2=python_13.config)  # -> config, config_scaled; inputs r1: list, r2: list
# ---------- config: Python ----------
import math

config = robot.zero_configuration()

for i in range(6):
    config['r1_joint_{}'.format(i + 1)] = r1[i]
    config['r2_joint_{}'.format(i + 1)] = r2[i]

#mm
config['r1_cart_joint'] = r1[6]
config['r2_cart_joint'] = r2[6]

print config

#for use in path planning
#radians and meters
config_scaled = robot.zero_configuration()

for i in range(6):
    config_scaled['r1_joint_{}'.format(i + 1)] = math.radians(r1[i])
    config_scaled['r2_joint_{}'.format(i + 1)] = math.radians(r2[i])

#mm --> m
config_scaled['r1_cart_joint'] = r1[6]/1000
config_scaled['r2_cart_joint'] = r2[6]/1000

print config_scaled
# ---------- end config ----------

# ----
# Return Preset
python_14 = GhPythonScript()  # -> out, config
# ---------- python_14: Python ----------
#RETURN CONFIG (BEFORE PICKUP)

#axis 1-6 + track (mm)
config = [
-90.0,
0.0,
0.0,
0.0,
90,
180,
100]
# ---------- end python_14 ----------
python_15 = GhPythonScript()  # -> out, config
# ---------- python_15: Python ----------
#RETURN CONFIG (BEFORE PICKUP)

#axis 1-6 + track
config = [
90.0,
0.0,
0.0,
0.0,
90,
180,
3900]
# ---------- end python_15 ----------
config_2 = GhPythonScript(robot=data_15, r1=python_14.config, r2=python_15.config)  # -> config, config_scaled; inputs r1: list, r2: list; same code as config

# ----
# FK
config_3 = GhPythonScript(robot=data_15, r1=data_5, r2=data_6)  # -> config; inputs r1: list, r2: list
# ---------- config_3: Python ----------
import math

config = robot.zero_configuration()

for i in range(6):
    config['r1_joint_{}'.format(i + 1)] = math.radians(r1[i])
    config['r2_joint_{}'.format(i + 1)] = math.radians(r2[i])

config['r1_cart_joint'] = r1[6]
config['r2_cart_joint'] = r2[6]

print config
# ---------- end config_3 ----------
gripper_frames = GhPythonScript(robot=data_15, config=config_3)  # -> out
# ---------- gripper_frames: Python ----------
print repr(robot.forward_kinematics(config, group='robot1_axis_gripper'))
print repr(robot.forward_kinematics(config, group='robot2_axis_gripper'))
# ---------- end gripper_frames ----------
panel_26 = Panel(gripper_frames)

# ----
# IK
panel_27 = Panel(rob_num)
pln_26 = Plane(pln_5)
pln_27 = Plane(pln)
filter_3 = StreamFilter(Gate=panel_27, Stream1=pln_26, Stream2=pln_27)
use_fk_as_start = BooleanToggle(True)
filter_4 = StreamFilter(Gate=use_fk_as_start)
ik = InverseKinematics(robot=data_15, plane=filter_3, start_configuration=config_3, group=data_17)  # -> configuration
#   port plane: The plane or frame to calculate the inverse kinematic for.
#   port start_configuration: If passed, calculates the inverse such that the joint positions differ the least from the start_configuration. Defaults to the zero configuration.
#   port group: The planning group used for calculation. Defaults to the robot's main planning group.
#   port configuration: The planning group's configuration.
# ---------- ik: Python ----------
"""
Calculate the robot's inverse kinematic for a given plane.

COMPAS FAB v0.19.1
"""
from ghpythonlib.componentbase import executingcomponent as component

from compas_fab.ghpython.components import coerce_frame


class InverseKinematics(component):
    def RunScript(self, robot, plane, start_configuration, group):
        configuration = None
        if robot and robot.client and robot.client.is_connected and plane:
            frame = coerce_frame(plane)
            configuration = robot.inverse_kinematics(frame, start_configuration, group)
        if start_configuration:
            return start_configuration.merged(configuration)
        else:
            return configuration
# ---------- end ik ----------

filter_5 = StreamFilter(Gate=list, Stream0=config_3, Stream1=ik, Stream2=config.config_scaled, Stream3=config_2.config_scaled)
robot_visualize = RobotVisualize(robot=data_15, configuration=filter_5)  # -> visual, collision, attached_meshes, frames, base_frame, ee_frame; inputs attached_collision_meshes: list, show_visual: Boolean, show_collision: Boolean, show_frames: Boolean, show_base_frame: Boolean, show_end_effector_frame: Boolean, show_acm: Boolean
#   port group: The planning group used for end-effector and base visualization.
#   port configuration: The robot's full configuration.
#   port attached_collision_meshes: A list of attached collision meshes.
#   port show_visual: Whether or not to show the robot's visual meshes.
#   port show_collision: Whether or not to show the robot's collision meshes.
#   port show_frames: Whether or not to show the robot's joint frames.
#   port show_base_frame: Whether or not to show the robot's base frame.
#   port show_end_effector_frame: Whether or not to show the robot's end-effector frame.
#   port show_acm: Whether or not to show the attached collision meshes (if any).
#   port visual: The robot's visual Rhino meshes (if any).
#   port collision: The robot's collision Rhino meshes (if any).
#   port attached_meshes: The attached collision Rhino meshes (if any).
#   port frames: The robot's joint frames as Rhino planes (if any).
#   port base_frame: The robot's base frame as a Rhino plane (if any).
#   port ee_frame: The robot's end-effector frame as a Rhino plane (if any).
# ---------- robot_visualize: Python ----------
"""
Visualizes the robot.

COMPAS FAB v0.19.1
"""
from compas.geometry import Frame
from compas.geometry import Transformation
from compas_ghpython.artists import FrameArtist
from compas_ghpython.artists import MeshArtist
from ghpythonlib.componentbase import executingcomponent as component


class RobotVisualize(component):
    def RunScript(self, robot, group, configuration, attached_collision_meshes, show_visual, show_collision,
                  show_frames, show_base_frame, show_end_effector_frame, show_acm):

        visual = None
        collision = None
        attached_meshes = None
        frames = None
        base_frame = None
        ee_frame = None

        if robot:
            show_visual = True if show_visual is None else show_visual
            configuration = configuration or robot.zero_configuration()

            robot.update(configuration, visual=show_visual, collision=show_collision)
            compas_frames = robot.transformed_frames(configuration, group)

            if show_visual:
                visual = robot.artist.draw_visual()

            if show_collision:
                collision = robot.artist.draw_collision()

            if show_base_frame:
                base_compas_frame = compas_frames[0]
                artist = FrameArtist(base_compas_frame)
                base_frame = artist.draw()

            if show_end_effector_frame:
                ee_compas_frame = robot.forward_kinematics(configuration, group, options=dict(solver='model'))
                artist = FrameArtist(ee_compas_frame)
                ee_frame = artist.draw()

            if show_frames:
                frames = []
                for compas_frame in compas_frames[1:]:
                    artist = FrameArtist(compas_frame)
                    frame = artist.draw()
                    frames.append(frame)

            if show_acm:
                attached_meshes = []
                for acm in attached_collision_meshes:
                    frame = robot.forward_kinematics(configuration, options=dict(solver='model', link_name=acm.link_name))
                    T = Transformation.from_frame_to_frame(Frame.worldXY(), frame)
                    mesh = acm.collision_mesh.mesh.transformed(T)
                    attached_meshes.append(MeshArtist(mesh).draw())

        return (visual, collision, attached_meshes, frames, base_frame, ee_frame)
# ---------- end robot_visualize ----------

scene = PlanningScene(robot=data_15)  # -> scene
#   port scene: A planning scene.
# ---------- scene: Python ----------
"""
Create a planning scene.

COMPAS FAB v0.19.1
"""
from ghpythonlib.componentbase import executingcomponent as component
from scriptcontext import sticky as st

from compas_fab.ghpython.components import create_id
from compas_fab.robots import PlanningScene


class PlanningSceneComponent(component):
    def RunScript(self, robot):
        key = create_id(self, 'planning_scene')
        if robot:
            st[key] = PlanningScene(robot)
        return st.get(key, None)
# ---------- end scene ----------
mesh_8 = Mesh(item_5)
mesh_9 = Mesh(flatten(mesh_3))
mesh_10 = Mesh(item_5)
shift_2 = ShiftList(List=flatten(mesh_9), Shift=-1, Wrap=False)
mjoin = MeshJoin(Meshes=shift_2)
mesh_11 = Mesh(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)
acm = AttachedCollisionMesh(
    scene=scene,
    mesh=mesh_8,
    identifier="member",
    link_name="r1_tcp",
    touch_links="r1_gripper",
    add=Button(),
    remove=Button())  # -> attached_collision_mesh; inputs mesh: Mesh, touch_links: list, add: Boolean, remove: Boolean
#   port scene: The planning scene.
#   port mesh: A collision mesh.
#   port identifier: The identifier of the collision mesh.
#   port link_name: The robot's link name to attach the mesh to.
#   port touch_links: Names of links that the robot is allowed to touch.
#   port add: If True, adds the collision mesh to the planning scene.
#   port remove: If True, removes the collision mesh from the planning scene.
#   port attached_collision_mesh: A collision mesh that is attached to a robot's link.
# ---------- acm: Python ----------
"""
Add an attached collision mesh to the robot.

COMPAS FAB v0.19.1
"""
from ghpythonlib.componentbase import executingcomponent as component

from compas_rhino.geometry import RhinoMesh
from compas_fab.robots import AttachedCollisionMesh
from compas_fab.robots import CollisionMesh


class AttachedCollisionMeshComponent(component):
    def RunScript(self, scene, mesh, identifier, link_name, touch_links, add, remove):
        attached_collision_mesh = None
        if scene and mesh and identifier and link_name:
            compas_mesh = RhinoMesh.from_geometry(mesh).to_compas()
            collision_mesh = CollisionMesh(compas_mesh, identifier)
            attached_collision_mesh = AttachedCollisionMesh(collision_mesh, link_name, touch_links)
            if add:
                scene.add_attached_collision_mesh(attached_collision_mesh)
            if remove:
                scene.remove_attached_collision_mesh(identifier)
                scene.remove_collision_mesh(identifier)
        return attached_collision_mesh
# ---------- end acm ----------
acm_2 = AttachedCollisionMesh(
    scene=scene,
    mesh=mesh_10,
    identifier="member",
    link_name="r2_tcp",
    touch_links="r2_gripper",
    add=Button(),
    remove=Button())  # -> attached_collision_mesh; inputs mesh: Mesh, touch_links: list, add: Boolean, remove: Boolean; same code as acm
cm = CollisionMesh(scene=scene, mesh=simplify(mjoin), identifier="structure_mesh", add=Button(), remove=Button())  # -> ok; inputs mesh: Mesh, add: Boolean, remove: Boolean
#   port scene: The planning scene.
#   port mesh: A collision mesh.
#   port identifier: The identifier of the collision mesh.
#   port add: If True, adds the collision mesh to the planning scene.
#   port remove: If True, removes the collision mesh from the planning scene.
#   port ok: True if the operation was successfully performed.
# ---------- cm: Python ----------
"""
Add or remove a collision mesh from the planning scene.

COMPAS FAB v0.19.1
"""
from compas_rhino.geometry import RhinoMesh
from ghpythonlib.componentbase import executingcomponent as component

from compas_fab.robots import CollisionMesh


class CollisionMeshComponent(component):
    def RunScript(self, scene, M, name, add, remove):
        ok = False
        if scene and M and name:
            mesh = RhinoMesh.from_geometry(M).to_compas()
            collision_mesh = CollisionMesh(mesh, name)
            if add:
                scene.add_collision_mesh(collision_mesh)
                ok = True
            if remove:
                scene.remove_collision_mesh(name)
                ok = True
        return ok
# ---------- end cm ----------
cm_2 = CollisionMesh(scene=scene, mesh=mesh_11, identifier="base_mesh", add=Button(), remove=Button())  # -> ok; inputs mesh: Mesh, add: Boolean, remove: Boolean; same code as cm
panel_28 = Panel(cm_2)
panel_29 = Panel(cm)

constraints_from_plane = ConstraintsFromPlane(robot=data_15, plane=pln_24, group=data_17)  # -> constraints
#   port plane: The plane or frame from which we create position and orientation constraints.
#   port group: The planning group for which we specify the constraint. Defaults to the robot's main planning group.
#   port tolerance_position: The allowed tolerance to the frame's position (defined in the robot's units). Defaults to 0.001
#   port tolerance_xaxis: The allowed tolerance of the frame's X-axis in degrees.
#   port tolerance_yaxis: The allowed tolerance of the frame's Y-axis in degrees.
#   port tolerance_zaxis: The allowed tolerance of the frame's Z-axis in degrees.
#   port constraints: A list containing a position and an orientation constraint.
# ---------- constraints_from_plane: Python ----------
"""
Create a position and an orientation constraint from a plane calculated for the group's end-effector link.

COMPAS FAB v0.19.1
"""
import math

from ghpythonlib.componentbase import executingcomponent as component

from compas_fab.ghpython.components import coerce_frame


class ConstraintsFromPlane(component):
    def RunScript(self, robot, plane, group, tolerance_position, tolerance_xaxis, tolerance_yaxis, tolerance_zaxis):
        goal_constraints = None
        if robot and plane:
            tolerance_position = tolerance_position or 0.001
            tolerance_xaxis = tolerance_xaxis or 1.
            tolerance_yaxis = tolerance_yaxis or 1.
            tolerance_zaxis = tolerance_zaxis or 1.

            frame = coerce_frame(plane)
            tolerances_axes = [math.radians(tolerance_xaxis), math.radians(tolerance_yaxis), math.radians(tolerance_zaxis)]
            goal_constraints = robot.constraints_from_frame(frame, tolerance_position, tolerances_axes, group)

        return goal_constraints
# ---------- end constraints_from_plane ----------
plan_motion = PlanMotion(robot=data_15, goal_constraints=constraints_from_plane, start_configuration=filter_5, group=data_17, compute=Button())  # -> trajectory; inputs goal_constraints: list, attached_collision_meshes: list of Mesh, path_constraints: list, compute: Boolean
#   port goal_constraints: The goal to be achieved, defined in a set of constraints. Constraints can be very specific, for example defining value domains for each joint, such that the goal configuration is included, or defining a volume in space, to which a specific robot link (e.g. the end-effector) is required to move to.
#   port start_configuration: The robot's full configuration, i.e. values for all configurable joints of the entire robot, at the starting position. Defaults to the all-zero configuration.
#   port group: The planning group used for calculation. Defaults to the robot's main planning group.
#   port attached_collision_meshes: A list of attached collision meshes to be included for planning.
#   port path_constraints: Optional constraints that can be imposed along the solution path. Note that path calculation won't work if the start_configuration violates these constraints. Defaults to None.
#   port planner_id: The name of the algorithm used for path planning. Defaults to 'RRTConnectkConfigDefault'
#   port compute: If True, calculates a trajectory.
#   port trajectory: The calculated trajectory.
# ---------- plan_motion: Python ----------
"""
Calculate a motion path.

COMPAS FAB v0.19.1
"""
from ghpythonlib.componentbase import executingcomponent as component
from scriptcontext import sticky as st

from compas_fab.ghpython.components import create_id


class PlanMotion(component):
    def RunScript(self, robot, goal_constraints, start_configuration, group, attached_collision_meshes, path_constraints, planner_id, compute):

        key = create_id(self, 'trajectory')

        path_constraints = list(path_constraints) if path_constraints else None
        attached_collision_meshes = list(attached_collision_meshes) if attached_collision_meshes else None
        planner_id = str(planner_id) if planner_id else 'RRTConnectkConfigDefault'

        if robot and robot.client and robot.client.is_connected and start_configuration and goal_constraints and compute:
            st[key] = robot.plan_motion(goal_constraints,
                                        start_configuration=start_configuration,
                                        group=group,
                                        options=dict(
                                            attached_collision_meshes=attached_collision_meshes,
                                            path_constraints=path_constraints,
                                            planner_id=planner_id,
                                        ))

        trajectory = st.get(key, None)
        return trajectory
# ---------- end plan_motion ----------
trajectory_visualize = TrajectoryVisualize(robot=data_15, group=data_17, trajectory=plan_motion)  # -> start_configuration, configurations, fraction, time, planes, P, V, A
#   port group: The planning group for which this trajectory was planned.
#   port trajectory: The calculated trajectory.
#   port start_configuration: The start configuration of the trajectory.
#   port configurations: The full configurations along the trajectory.
#   port fraction: Indicates the fraction of requested trajectory that was calculated, e.g. 1 means the full trajectory was found.
#   port time: The time which is needed to execute that trajectory at full speed.
#   port planes: The planes of the robot's end-effector.
#   port P: The positions along the trajectory
#   port V: The velocities along the trajectory
#   port A: The accelerations along the trajectory
# ---------- trajectory_visualize: Python ----------
"""
Visualizes a trajectory.

COMPAS FAB v0.19.1
"""
from compas_ghpython import draw_frame
from compas_ghpython import list_to_ghtree
from ghpythonlib.componentbase import executingcomponent as component


class TrajectoryVisualize(component):
    def RunScript(self, robot, group, trajectory):
        start_configuration = None
        configurations = []
        fraction = 0.
        time = 0.

        planes = []
        positions = []
        velocities = []
        accelerations = []

        if robot and trajectory:
            group = group or robot.main_group_name

            for c in trajectory.points:
                configurations.append(robot.merge_group_with_full_configuration(c, trajectory.start_configuration, group))
                frame = robot.forward_kinematics(c, group, options=dict(solver='model'))
                planes.append(draw_frame(frame))
                positions.append(c.positions)
                velocities.append(c.velocities)
                accelerations.append(c.accelerations)

            start_configuration = trajectory.start_configuration
            fraction = trajectory.fraction
            time = trajectory.time_from_start

        P = list_to_ghtree(list(zip(*positions)))
        V = list_to_ghtree(list(zip(*velocities)))
        A = list_to_ghtree(list(zip(*accelerations)))

        # return outputs if you have them; here I try it for you:
        return (start_configuration, configurations, fraction, time, planes, P, V, A)
# ---------- end trajectory_visualize ----------
item_6 = ListItem(List=trajectory_visualize.configurations, Index=Slider(27, range=0..50), Wrap=False)
robot_visualize_2 = RobotVisualize(robot=data_15, configuration=item_6)  # -> visual, collision, attached_meshes, frames, base_frame, ee_frame; inputs attached_collision_meshes: list, show_visual: Boolean, show_collision: Boolean, show_frames: Boolean, show_base_frame: Boolean, show_end_effector_frame: Boolean, show_acm: Boolean; same code as robot_visualize

panel_30 = Panel("take last path")
item_7 = ListItem(List=trajectory_visualize.configurations, Index="-1", Wrap=True)

constraints_from_plane_2 = ConstraintsFromPlane(robot=data_15, plane=pln_25, group=data_17)  # -> constraints; same code as constraints_from_plane
plan_motion_2 = PlanMotion(robot=data_15, goal_constraints=constraints_from_plane_2, start_configuration=item_7, group=data_17, compute=Button())  # -> trajectory; inputs goal_constraints: list, attached_collision_meshes: list of Mesh, path_constraints: list, compute: Boolean; same code as plan_motion
trajectory_visualize_2 = TrajectoryVisualize(robot=data_15, group=data_17, trajectory=plan_motion_2)  # -> start_configuration, configurations, fraction, time, planes, P, V, A; same code as trajectory_visualize
item_8 = ListItem(List=trajectory_visualize_2.configurations, Index=Slider(0, range=0..50), Wrap=False)
robot_visualize_3 = RobotVisualize(robot=data_15, configuration=item_8)  # -> visual, collision, attached_meshes, frames, base_frame, ee_frame; inputs attached_collision_meshes: list, show_visual: Boolean, show_collision: Boolean, show_frames: Boolean, show_base_frame: Boolean, show_end_effector_frame: Boolean, show_acm: Boolean; disabled; same code as robot_visualize

panel_31 = Panel("C:/Users/Edvard/Documents/GitHub/workshop_princeton_2021/ACADIA/input_data/planned_paths")
panel_32 = Panel(panel)
python_16 = GhPythonScript(path=panel_31, member_num=panel_32, read_data=Toggle(True))  # -> configs
# ---------- python_16: Python ----------
import os
from compas_fab.utilities import read_data_from_json
from compas_fab.robots import Configuration

if read_data:
    data = read_data_from_json(os.path.join(path, 'member_{}_end.json'.format(member_num)))

    print data['config_1']
    print len(data)

configs = []
for i in range(len(data)):
    configs.append(Configuration.from_data(data['config_{}'.format(i)]))
    
print configs[1]
# ---------- end python_16 ----------
python_17 = GhPythonScript(configs=trajectory_visualize_2.configurations, path=panel_31, member_num=panel_32, save_data=Button())  # inputs configs: list
# ---------- python_17: Python ----------
import os
from compas_fab.utilities import write_data_to_json

configs_combined = {}
if save_data:
    for i,c in enumerate(configs):
        configs_combined['config_{}'.format(i)] = c.to_data()
        #c.to_json(os.path.join(path, 'member_{}/config_{}.json'.format(member_num,i)))

    #print configs_combined
    write_data_to_json(configs_combined, os.path.join(path, 'member_{}_end.json'.format(member_num)))
# ---------- end python_17 ----------
python_18 = GhPythonScript(configs=python_16)  # -> out, r1_place, r2_place; inputs configs: list
# ---------- python_18: Python ----------
import math
import compas_rrc as rrc

#configs = configs
    
r1_place = []
r2_place = []
for c in configs:
    r1_axes = rrc.ExternalAxes(c['r1_cart_joint']*1000)
    r1_joints = rrc.RobotJoints(
        math.degrees(c['r1_joint_1']),
        math.degrees(c['r1_joint_2']),
        math.degrees(c['r1_joint_3']),
        math.degrees(c['r1_joint_4']),
        math.degrees(c['r1_joint_5']),
        math.degrees(c['r1_joint_6']),
    )
    
    r2_axes = rrc.ExternalAxes(c['r2_cart_joint']*1000)
    r2_joints = rrc.RobotJoints(
        math.degrees(c['r2_joint_1']),
        math.degrees(c['r2_joint_2']),
        math.degrees(c['r2_joint_3']),
        math.degrees(c['r2_joint_4']),
        math.degrees(c['r2_joint_5']),
        math.degrees(c['r2_joint_6']),
    )
    
    r1_place.append([r1_axes, r1_joints])
    r2_place.append([r2_axes, r2_joints])
# ---------- end python_18 ----------
data_18 = Data(python_18.r1_place)
data_19 = Data(python_18.r2_place)

panel_33 = Panel("C:/Users/Edvard/Documents/GitHub/workshop_princeton_2021/ACADIA/input_data/planned_paths")
panel_34 = Panel(panel)
python_19 = GhPythonScript(path=panel_33, member_num=panel_34, read_data=Toggle(True))  # -> configs
# ---------- python_19: Python ----------
import os
from compas_fab.utilities import read_data_from_json
from compas_fab.robots import Configuration

if read_data:
    data = read_data_from_json(os.path.join(path, 'member_{}_start.json'.format(member_num)))

    print data['config_1']
    print len(data)

configs = []
for i in range(len(data)):
    configs.append(Configuration.from_data(data['config_{}'.format(i)]))
    
print configs[1]
   
print configs[0]['r1_joint_6']
# ---------- end python_19 ----------
python_20 = GhPythonScript(configs=trajectory_visualize.configurations, path=panel_33, member_num=panel_34, save_data=Button())  # inputs configs: list
# ---------- python_20: Python ----------
import os
from compas_fab.utilities import write_data_to_json

configs_combined = {}
if save_data:
    for i,c in enumerate(configs):
        configs_combined['config_{}'.format(i)] = c.to_data()
        #c.to_json(os.path.join(path, 'member_{}/config_{}.json'.format(member_num,i)))

    print configs_combined
    write_data_to_json(configs_combined, os.path.join(path, 'member_{}_start.json'.format(member_num)))
# ---------- end python_20 ----------
python_21 = GhPythonScript(configs=python_19)  # -> out, r1_place, r2_place; inputs configs: list; same code as python_18
data_20 = Data(python_21.r1_place)
data_21 = Data(python_21.r2_place)

data_22 = Data(data_12)
panel_35 = Panel(rob_num)
panel_36 = Panel(data_16)
data_23 = Data(config_2.config)
data_24 = Data(python_5)
data_25 = Data(python_6)
data_26 = Data(config.config)
data_27 = Data(data_20)
data_28 = Data(data_21)
data_29 = Data(data_18)
data_30 = Data(data_19)
python_22 = GhPythonScript(
    ros=data_22,
    rob_num=panel_35,
    wobj=panel_36,
    return_config=data_23,
    send_return=Button(),
    r1_pick_path=data_24,
    r2_pick_path=data_25,
    pick_config=data_26,
    send_pick=Button(),
    r1_place_startpath=data_27,
    r2_place_startpath=data_28,
    send_place_start=Button(),
    r1_place_endpath=data_29,
    r2_place_endpath=data_30,
    send_place_end=Button(),
    get_info=Toggle(False))  # -> out, current_joints; inputs rob_num: Int32, r1_pick_path: list, r2_pick_path: list, r1_place_startpath: list, r2_place_startpath: list, r1_place_endpath: list, r2_place_endpath: list
# ---------- python_22: Python ----------
import compas_rrc as rrc
from compas.geometry import Frame
from compas.geometry import Plane

from compas_rhino.geometry import RhinoPlane

# Create ABB Client (rob2 = right, rob1 = left)
if rob_num == 1:
    abb = rrc.AbbClient(ros, '/rob1')
    abb.send(rrc.SetTool('ecl_pneumatic_gripper'))
    DO = 'do_1'
    pick_path = r1_pick_path
    path_place_s = r1_place_startpath
    path_place_e = r1_place_endpath
    #pick_track = 100
    
    print('Connected.')
elif rob_num == 2:
    abb = rrc.AbbClient(ros, '/rob2')
    abb.send(rrc.SetTool('ecl_pneumatic_gripper'))
    DO = 'do_2'
    pick_path = r2_pick_path
    path_place_s = r2_place_startpath
    path_place_e = r2_place_endpath
    #pick_track = 3888.11
    
    print('Connected.')

# Define speeds
speed = 100

# set wobj
abb.send(rrc.SetWorkObject(wobj))

if get_info:
    current_joints = abb.send_and_wait(rrc.GetJoints(),  timeout = 3)
    print current_joints
    

if send_return:
    
    if rob_num == 1:
        axis = rrc.ExternalAxes(return_config['r1_cart_joint'])
        joints = rrc.RobotJoints(
            return_config['r1_joint_1'],
            return_config['r1_joint_2'],
            return_config['r1_joint_3'],
            return_config['r1_joint_4'],
            return_config['r1_joint_5'],
            return_config['r1_joint_6'],
        )
    elif rob_num == 2:
        axis = rrc.ExternalAxes(return_config['r2_cart_joint'])
        joints = rrc.RobotJoints(
            return_config['r2_joint_1'],
            return_config['r2_joint_2'],
            return_config['r2_joint_3'],
            return_config['r2_joint_4'],
            return_config['r2_joint_5'],
            return_config['r2_joint_6'],
        )
        
    done = abb.send(rrc.MoveToJoints(joints, axis, speed, rrc.Zone.FINE))
    print('Finished')


if send_pick:
    #open gripper
    done = abb.send_and_wait(rrc.SetDigital(DO,0), timeout = 10)
    
    done = abb.send_and_wait(rrc.MoveToFrame(pick_path[0], speed, rrc.Zone.FINE), timeout = 30)
    future = abb.send(rrc.Stop(feedback_level=rrc.FeedbackLevel.DONE))
    
    done = abb.send_and_wait(rrc.MoveToFrame(pick_path[1], speed, rrc.Zone.FINE), timeout = 30)
    future = abb.send(rrc.Stop(feedback_level=rrc.FeedbackLevel.DONE))
        
    #close gripper
    done = abb.send_and_wait(rrc.SetDigital(DO,1), timeout = 10)
    
    #back to start frame
    done = abb.send_and_wait(rrc.MoveToFrame(pick_path[0], speed, rrc.Zone.FINE), timeout = 10)
    future = abb.send(rrc.Stop(feedback_level=rrc.FeedbackLevel.DONE))
    
    #Final hard-coded config, path planning starts from here
    if rob_num == 1:
        axis = rrc.ExternalAxes(pick_config['r1_cart_joint'])
        joints = rrc.RobotJoints(
            pick_config['r1_joint_1'],
            pick_config['r1_joint_2'],
            pick_config['r1_joint_3'],
            pick_config['r1_joint_4'],
            pick_config['r1_joint_5'],
            pick_config['r1_joint_6'],
        )
    elif rob_num == 2:
        axis = rrc.ExternalAxes(pick_config['r2_cart_joint'])
        joints = rrc.RobotJoints(
            pick_config['r2_joint_1'],
            pick_config['r2_joint_2'],
            pick_config['r2_joint_3'],
            pick_config['r2_joint_4'],
            pick_config['r2_joint_5'],
            pick_config['r2_joint_6'],
        )
        
    done = abb.send(rrc.MoveToJoints(joints, axis, speed, rrc.Zone.FINE))
    print('Finished')
    
    
if send_place_start:
    # execute planned path
    # formatted as RobotJoints and ExternalAxes object 
    
    last_axis, last_joints = path_place_s.pop(-1)
    
    for axis,joints in path_place_s:
        print axis, joints
        done = abb.send(rrc.MoveToJoints(joints, axis, speed, rrc.Zone.Z10))
    
    done = abb.send(rrc.MoveToJoints(last_joints, last_axis, speed, rrc.Zone.FINE))
    
    print('Finished')

if send_place_end:
    
    # execute planned path
    # formatted as RobotJoints and ExternalAxes object 
    
    last_axis, last_joints = path_place_e.pop(-1)
    
    for axis,joints in path_place_e:
        print axis, joints
        done = abb.send(rrc.MoveToJoints(joints, axis, speed/3, rrc.Zone.Z10))
        
    done = abb.send(rrc.MoveToJoints(last_joints, last_axis, speed/3, rrc.Zone.FINE))

    print('Finished')
# ---------- end python_22 ----------

panel_37 = Panel(python_22.out)
panel_38 = Panel(python_22.current_joints)
panel_39 = Panel(python_16)
panel_40 = Panel(python_19)
